# Grasshopper definition 4_AnnualWindAnalysis.ghx (Grasshopper 1.0.7)
# plug-ins: Eddy3D

panel = Panel("""0
135
150
180
225
25
260
270
275
280
300
315
350
45
50
90""")

# ----
# 1. Geometry &
# Boundary Conditions
# C:\Users\pkastner\Google Drive\Patrick\Papers\CPGenerator\Conference\Data\Weather\AUS_NSW.Dubbo.Airport.957190_RMY.epw
panel_2 = Panel("C:\DIVA\WeatherData\USA_IL_Chicago-OHare.Intl.AP.725300_TMY3.epw")
panel_3 = Panel("""0
22
45
90
135
180
225
270
315""")
geo = Geometry([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])
abl = ABL(WDir=panel, Uref="10", Zref=10, Z0=1, ZGround=0, Epw=panel_2)

abl_flow = ABLFlow(ReferenceVelocityAtZref_m_s=5, ReferenceHeight_m=10, SurfaceRoughnessHeight_m=1, MinimumZCoordinate_m=0)
domainbox = BoxShapedDomain(Geometry=geo, BoundaryCondition=abl_flow, BlockSize=20)  # -> Domain, Mesh; disabled
simulation = Simulation(
    SimulationDomain=domainbox.Domain,
    WorkingDirectory="C:\Users\pkastner\Eddy",
    RunMeshing=False,
    RunSimulation=False,
    RunSimulation_2=False,
    runWithBlueCFD=True)  # disabled

# ----
# 3. Mesh & Simulation
panel_4 = Panel("C:\test_cyl")
panel_5 = Panel("-1")
mset = MeshSettings(AccBuilding=2, AccFeatures="2", AccRefinement=0, AccGround=2, NLayer=3, Mode=1, Mode_2=1)

rset = RunSettings(
    NumberOfIterations="200",
    WriteInterval=20,
    NumberOfTimestepsToKeep=3,
    TurbulenceModel=1,
    RelaxationFactors=3,
    SolutionAndAlgorithmControl=1,
    PotentialFoamInitialization=False,
    NumberOfCPUs=Slider(2, range=0..10),
    OperatingSystem=0)

# ----
# 6. Clean
button = Button()
clean = Clean(Directory=panel_4, Mode=2, Run=button)

# ----
# 5. Post-processing
# 5.1. Paraview
# 5.2. Grasshopper
button_2 = Button()
dir = Slider(2, range=0..7)
# 5.3. Grasshopper
button_3 = Button()
c_script = CSharpScript(
    URefEPW=Slider(10, range=0..10),
    probingHeight=Slider(1, range=0..20),
    zref=Slider(10, range=0..10),
    z0=Slider(1, range=0..10))  # -> out, A; inputs URefEPW: Double, probingHeight: Double, zref: Double, z0: Double
# ---------- c_script: C# ----------
  
  

A =  ((0.41 * URefEPW) / Math.Log((zref + z0) / z0) / 0.41) * Math.Log((probingHeight + z0) / z0);
# ---------- end c_script ----------
panel_6 = Panel(c_script.A)
# Pedestrian wind comfort (NEN8100)
number_slider = Slider(11, range=0..30)
Y = UnitY(Factor="200")
move = Move(Geometry=geo, Motion=Y)  # -> Geometry, Transform

# ----
# 2. Simulation Domain
number_slider_2 = Slider(50, range=0..1000)

domaincyl = CylindricalDomain(
    Geometry=geo,
    BoundaryCondition=abl,
    BlockSize="10",
    SizeOfInnerRectangle=number_slider_2,
    SizeOfOuterRadius=Slider(300, range=0..1000),
    Height=Slider(80, range=0..1000))  # -> Domain, Mesh

cellsize = CellSize(SimulationDomain=domaincyl.Domain, BlockSize="10", DesiredCellSize=Slider(5, range=0..10))

python = GhPythonScript(x=domaincyl.Domain)  # -> out, a; disabled
# ---------- python: Python ----------
__author__ = "pkastner"
__version__ = "2020.05.03"

import rhinoscriptsyntax as rs

a = x.DomainMesh
# ---------- end python ----------
panel_7 = Panel(python.a)  # disabled
simulation_2 = Simulation(
    SimulationDomain=domaincyl.Domain,
    WorkingDirectory=panel_4,
    MeshSettings=mset,
    RunSettings=rset,
    RunMeshing=Button(),
    MakeTrees=False,
    RunSimulation=Button(),
    runWithBlueCFD=True)
residuals = Residuals(Result=simulation_2, SelectionOfWindDirections="0", X=":", Y=":", Version=0, Run=Button(), visResiduals=False)

# ----
# 4. Probing points & probing
number_slider_3 = Slider(3, range=1..50)
brep = Brep(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)
meshplane = MeshPlane(brep=brep, number=number_slider_3, B=geo)  # -> L, faces
visprobes = VisualizeProbes(Result=simulation_2, ProbingPoints=meshplane.L, NameOfInstance="cyl", NameOfField=0, Run=Button(), Culling=True)  # -> PorbingPoints, ProbingResult

vectors = Data(visprobes.ProbingResult)
points = Data(visprobes.PorbingPoints)
paraview = Paraview(Result=simulation_2, ParaviewVersion=2, Run=button_2)
# Multi-directional / annual wind vectors
choose_dir = TreeBranch(Tree=vectors, Path=dir, MaintainPaths=True)
wind_factors = WindFactors(Result=simulation_2, ProbingPoints=points, WindVelocity=vectors, Run=button_3, Interpolation=False)  # -> WindFactors, AnnualWindVelocities
cluster = Cluster(data=choose_dir)  # -> S, E, data_3
cluster_2 = Cluster_3(C=points, T=Y)
gradient = Gradient(
    LowerLimit=cluster.S,
    UpperLimit=Slider(6, range=0..10),
    Parameter=cluster.data_3,
    stops=[0.103: RGB(0, 0, 255), 0.22: RGB(0, 170, 255), 0.305: RGB(0, 255, 255), 0.398: RGB(0, 255, 188), 0.504: RGB(0, 255, 106), 0.605: RGB(91, 255, 0), 0.699: RGB(184, 255, 0), 0.799: RGB(255, 255, 0), 0.898: RGB(255, 170, 0)])
wind_comfort = AnnualWindComfort(AnnualWindVelocities=wind_factors.AnnualWindVelocities, WindComfortIndex=4)
dedata = DeconstructDataObjects(Data=wind_factors.WindFactors, Hours=number_slider)
dedata_2 = DeconstructDataObjects(Data=wind_factors.AnnualWindVelocities, Hours=number_slider)
flip = FlipMatrix(Data=dedata)
flip_2 = FlipMatrix(Data=dedata_2)
avr = Average(Input=flip)  # -> flatten(ArithmeticMean)
avr_2 = Average(Input=flip_2)  # -> flatten(ArithmeticMean)
vdisex = VectorDisplayEx(Point=points, Vector=choose_dir, Colour=gradient, Width=Slider(3, range=0..10))  # disabled
data = Data(avr_2)
cluster_3 = Cluster(data=data)  # -> S, E, data_3
gradient_2 = Gradient(
    LowerLimit="0",
    UpperLimit="5",
    Parameter=cluster_3.data_3,
    stops=[0.103: RGB(0, 0, 255), 0.22: RGB(0, 170, 255), 0.305: RGB(0, 255, 255), 0.398: RGB(0, 255, 188), 0.504: RGB(0, 255, 106), 0.605: RGB(91, 255, 0), 0.699: RGB(184, 255, 0), 0.799: RGB(255, 255, 0), 0.898: RGB(255, 170, 0)])
panel_8 = Panel(avr_2)
panel_9 = Panel(avr)
panel_10 = Panel(wind_comfort)
preview = CustomPreview(Geometry=cluster_2, Material=gradient_2)

# ==== cluster MeshPlane
B = ClusterInput()
number = ClusterInput()
number_2 = Number(number)
settings_custom = SettingsCustom(
    StitchSeams=True,
    SimplePlanes=False,
    Refine=True,
    MinCount=16,
    MaxCount=400,
    AspectRatio=20,
    MaxDistance=0,
    MaxAngle=20,
    MinEdge=number_2,
    MaxEdge=number_2)
brep = ClusterInput()
mesh_brep = MeshBrep(Brep=brep, Settings=settings_custom)
deconstruct_mesh = DeconstructMesh(Mesh=mesh_brep)  # -> Vertices, Faces, Colours, Normals
brepsinc = PointInBreps(Brep=B, Point=deconstruct_mesh.Vertices, Strict=False)  # -> Inside, Index
not = GateNot(A=brepsinc.Inside)
cull = CullPattern(List=deconstruct_mesh.Vertices, CullPattern=not)
faces = ClusterOutput(deconstruct_mesh.Faces)
L = ClusterOutput(cull)

# ==== cluster Cluster
data = ClusterInput()
data_2 = Data(data)
data_3 = ClusterOutput(data_2)
bnd = Bounds(Numbers=data_2)
dedomain = DeconstructDomain(Domain=bnd)  # -> Start, End
S = ClusterOutput(dedomain.Start)
E = ClusterOutput(dedomain.End)

# ==== cluster Cluster_3
C = ClusterInput()
T = ClusterInput()
cluster = Cluster_2(C=C)
move = Move(Geometry=cluster, Motion=T)  # -> Geometry, Transform
G = ClusterOutput(move.Geometry)

# ==== cluster Cluster_2
C = ClusterInput()
circle = CircleCNR(Center=C, Normal=Vector(0, 0, 1), Radius=2)
srf = Surface(circle)
srf_2 = ClusterOutput(srf)
